# Grasshopper definition fecade metaball.gh (Grasshopper 1.0.8)
# plug-ins: Pufferfish, Bifocals, LunchBox

unit_z = UnitZ(Factor=Slider(1.6, range=0..10))
xy_plane = XYPlane(Origin=Point(0, 0, 0))
gene_pool = GenePool(Decimals=2, Maximum=30, Minimum=0, Value=[1.15, 4.91, 1.89, 4.91, 1.87, 5.06])
linear_array = LinearArray(Geometry=xy_plane, Direction=unit_z, Count=Slider(8, range=0..20))  # -> Geometry, Transform
points = Points([Point(134.7933516, 103.7931066, 0), Point(122.1126203, 115.9141712, 5.981433458), Point(145.1285188, 123.6886586, 0.1879846404), Point(131.1137217, 132.0918258, -0.00976956451), Point(145.5571346, 110.3379618, -0.7020990531), Point(118.9136883, 97.89485383, 0)])
metaball_t_custom = MetaBallTCustom(Points=points, Charge=gene_pool, Plane=linear_array.Geometry, Threshold=Slider(0.1, range=0.001..1))
point_list = PointList(Points=points, Size=Slider(3, range=0..10))
rebuild_curve = RebuildCurve(Curve=metaball_t_custom, Count=Slider(100, range=0..100), Degree=Slider(3, range=0..10), EndTangents=False)
boundary_surfaces = BoundarySurfaces(Edges=rebuild_curve)
unit_z_2 = UnitZ(Factor=Slider(1.6, range=0..10))
extrude = Extrude(Base=rebuild_curve, Direction=unit_z_2)

surface = Surface(<surface referenced from the Rhino model>)
diamond_panels = DiamondPanels(Surface=surface, UDivisions=10, VDivisions=10)  # -> DiamondPanels, TriPanels
explode = Explode(Curve=diamond_panels.DiamondPanels, Recursive=False)  # -> Segments, Vertices
list_item = ListItem(List=explode.Vertices, Index=0, Wrap=False)  # -> Item, Item1, Item2, Item3
line = Line(StartPoint=list_item.Item, EndPoint=list_item.Item2)
sub_curve = SubCurve(BaseCurve=reparameterize(line), Domain=line)
end_points = EndPoints(Curve=reverse(sub_curve))  # -> Start, End
unit_y = UnitY(Factor=Slider(2, range=0.1..10))
move = Move(Geometry=end_points.End, Motion=unit_y)  # -> Geometry, Transform
move_2 = Move(Geometry=end_points.Start, Motion=unit_y)  # -> Geometry, Transform
_4point_surface = _4PointSurface(CornerA=list_item.Item3, CornerB=list_item.Item, CornerC=move_2.Geometry)
_4point_surface_2 = _4PointSurface(CornerA=list_item.Item, CornerB=move_2.Geometry, CornerC=list_item.Item1)
_4point_surface_3 = _4PointSurface(CornerA=list_item.Item3, CornerB=list_item.Item2, CornerC=move.Geometry)
_4point_surface_4 = _4PointSurface(CornerA=list_item.Item2, CornerB=move.Geometry, CornerC=list_item.Item1)

file_path = FilePath("C:\Users\AsusIran\Desktop\epw\TehranEPW.epw")
day = Slider(15, range=1..31)
hours = Slider(17, range=0..24)
mou = Slider(6, range=1..12)
hours_2 = Slider(7, range=0..24)
mou_2 = Slider(6, range=1..12)
day_2 = Slider(1, range=1..31)
importepw = LBImportEPW(epw_file=file_path)  # -> location, dry_bulb_temperature, dew_point_temperature, relative_humidity, wind_speed, wind_direction, direct_normal_rad, diffuse_horizontal_rad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; plug-in component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
analysisperiod = LBAnalysisPeriod(start_month=mou, start_day=day, start_hour=hours_2, end_month=mou, end_day=day, end_hour=hours)  # -> period, hoys, dates; plug-in component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
sunpath = LBSunPath(location=importepw.location, hoys=analysisperiod.hoys, scale=0.002)  # -> out, vectors, altitudes, azimuths, hoys, sun_pts, analemma, daily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; plug-in component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
skymatrix = LBCumulativeSkyMatrix(
    location=importepw.location,
    direct_rad=importepw.direct_normal_rad,
    diffuse_rad=importepw.diffuse_horizontal_rad,
    hoys=analysisperiod.hoys)  # -> out, sky_mtx; plug-in component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
legendpar = LBLegendParameters()  # -> leg_par; plug-in component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
geometry = Geometry([<surface referenced from the Rhino model> x28])
incidentradiation = LBIncidentRadiation(
    sky_mtx=skymatrix.sky_mtx,
    geometry=flatten(geometry),
    grid_size=1,
    legend_par=legendpar,
    cpu_count=Toggle(False),
    run=Toggle(False))  # -> out, points, results, total, mesh, legend, title, int_mtx; plug-in component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
